# Grasshopper definition spiral_cup.gh (Grasshopper 1.0.7)

bump_height = Slider(5, range=0..10)
layer_height = Slider(33, range=0..100)
bump_width = Slider(5, range=5..20)
radius = Slider(52, range=0..100)
offset = Slider(7, range=0..100)
list = ValueList({"Square", "Triangle", "Loop"}, selected="Square")
python = GhPythonScript(radius=radius, layer_height=layer_height, offset=offset, bump_width=bump_width, bump_height=bump_height, shape_type=list)  # -> out, lines, turtle; inputs radius: Int32, layer_height: Int32, offset: Int32, bump_width: Int32, bump_height: Int32
# ---------- python: Python ----------
import rhinoscriptsyntax as rs
import sys
import operator as op
from spiral_cup import SpiralCup   # file

to_delete = list()
for module in sys.modules:
    if "spiral_cup" in module:
      to_delete.append(module)
for module in to_delete:
    sys.modules.pop(module)

s = SpiralCup()

lines = s.bump(layer_height, radius, bump_height, bump_width, offset, shape_type)

# lines = t.get_lines()
# turtle = t.draw_turtle()
# ---------- end python ----------
